# Dynamo graph FILIN_РасчетИнсоляции_АдаптивноеСемействоОкна_3dлучи.dyn (Dynamo 2.6.1.8786)
# packages: Data-Shapes 2021.2.94

# group: Get Center
выбрать_окно = DSModelElementSelection()  # 1 picked in the model; graph input
element_to_instance = Python(IN[0]=выбрать_окно)
# ---------- element_to_instance.python (29 lines) ----------
# -*- coding: utf-8 -*-

import clr

# Revit API
clr.AddReference('RevitAPI')
clr.AddReference('RevitServices')
from Autodesk.Revit.DB import *
from RevitServices.Persistence import DocumentManager
from RevitServices.Transactions import TransactionManager

doc = DocumentManager.Instance.CurrentDBDocument

# IN[0] – Element(s) from Dynamo (can be from "Select Model Elements" or "Select Model Element")
elements = UnwrapElement(IN[0])

if not isinstance(elements, list):
    elements = [elements]

family_instances = []

for el in elements:
    if isinstance(el, FamilyInstance):
        family_instances.append(el)
    else:
        family_instances.append(None)  # Not a family instance

# Output
OUT = family_instances
# ----------------------------------------
getChildElements = Element.GetChildElements(element=выбрать_окно)
string_from_object = FromObject(obj=getChildElements)
string = StringInput("ЦентрИнсоляции_Тех")
code_block = CodeBlock(a=string_from_object, b=string) { a==b; }
filterByBoolMask = List.FilterByBoolMask(list=getChildElements, mask=code_block)
getLocation = Element.GetLocation(element=filterByBoolMask.in)
code_block_2 = CodeBlock { 0; }
getItemAtIndex = List.GetItemAtIndex(list=getLocation, index=code_block_2)
id = Element.Id(element=выбрать_окно)

# group: ProjectNorth VECTOR Z = 0 X--NORTH Y--WEST/EAST
surveyPoint = Coordinates.SurveyPoint()  # frozen
X = Point.X(point=surveyPoint)
Y = Point.Y(point=surveyPoint)
Z = CodeBlock { 0; }
byCoordinates = Point.ByCoordinates(x=X, y=Y, z=Z)
x = CodeBlock { 0; }
Y_2 = CodeBlock { 1; }
byCoordinates_2 = Vector.ByCoordinates(x=x, y=Y_2, z=Z)

# group: True North Vector
ZAxis = Vector.ZAxis()
projectRotation = Coordinates.ProjectRotation()
rotate = Vector.Rotate(vector=byCoordinates_2, axis=ZAxis, degrees=projectRotation)

# group: True North Vector visualise
number_slider = DoubleSlider(1000, range=5..10000 step 1)  # frozen
code_block_3 = CodeBlock(a=number_slider) { a*1000; }
byStartPointDirectionLength = Line.ByStartPointDirectionLength(startPoint=byCoordinates, direction=rotate, length=code_block_3)

# group: ProjectNorth VECTOR visualise
number_slider_2 = DoubleSlider(50, range=5..10000 step 1)  # frozen
code_block_4 = CodeBlock(a=number_slider_2) { a*1000; }
byStartPointDirectionLength_2 = Line.ByStartPointDirectionLength(startPoint=byCoordinates, direction=byCoordinates_2, length=code_block_4)

# group: ClockWork Rotation From TrueNorth to ProjectNorth
angleWithVector = Vector.AngleWithVector(vector=byCoordinates_2, otherVector=rotate)  # frozen

# group: Get Project Coordinates
siteLocation = SiteLocation()
latitude = DynamoUnits.Location.Latitude(location=siteLocation)
longitude = DynamoUnits.Location.Longitude(location=siteLocation)

# group: Set +-: North + South - East + West-
широта_n_северная_s_южная = StringInput("n")  # graph input
python_script = Python(IN[0]=latitude, IN[1]=широта_n_северная_s_южная)
# ---------- python_script.python (18 lines) ----------
# Загрузить стандартную библиотеку Python и библиотеку DesignScript
import sys
import clr
clr.AddReference('ProtoGeometry')
from Autodesk.DesignScript.Geometry import *

lat=IN[0]
NS=IN[1]
TrueLat=()

NS=NS.upper()
if NS == "N":
	TrueLat=lat
if NS =="S":
	TrueLat=lat*-1

# Назначьте вывод переменной OUT.
OUT = TrueLat
# ----------------------------------------
долгота_w_восточная_e_западная = StringInput("w")  # graph input
python_script_2 = Python(IN[0]=longitude, IN[1]=долгота_w_восточная_e_западная)
# ---------- python_script_2.python (19 lines) ----------
# Загрузить стандартную библиотеку Python и библиотеку DesignScript
import sys
import clr
clr.AddReference('ProtoGeometry')
from Autodesk.DesignScript.Geometry import *

lat=IN[0]
WE=IN[1]
TrueLat=()
exeption=()

WE=WE.upper()
if WE == "W":
	TrueLat=lat
if WE =="E":
	TrueLat=lat*-1

# Назначьте вывод переменной OUT.
OUT = TrueLat
# ----------------------------------------

# group: Set Timezone
часовой_пояс_utc = DoubleSlider(3, range=-60..60 step 1)  # graph input

год = DoubleSlider(2020, range=2020..5000 step 1)  # graph input

# group: Set Start and End time
месяц = DoubleSlider(4, range=1..12 step 1)  # graph input
день = DoubleSlider(22, range=1..31 step 1)  # graph input
начало_расчета_час = DoubleSlider(6, range=0..24 step 1)  # graph input
начало_расчета_минута = DoubleSlider(0, range=0..60 step 1)  # graph input
byDateAndTime = DateTime.ByDateAndTime(year=год, month=месяц, day=день, hour=начало_расчета_час, minute=начало_расчета_минута)
string_from_array = FromArray(arr=byDateAndTime)
конец_расчета_час = DoubleSlider(18, range=0..24 step 1)  # graph input
конец_расчета_минута = DoubleSlider(0, range=0..60 step 1)  # graph input
byDateAndTime_2 = DateTime.ByDateAndTime(year=год, month=месяц, day=день, hour=конец_расчета_час, minute=конец_расчета_минута)
string_from_array_2 = FromArray(arr=byDateAndTime_2)

# group: Set calculation time period
расчетный_шаг_минута = DoubleSlider(20, range=0..60 step 1)  # graph input

# group: Resault: 0 - Time 1 -Azimuth 2 - Altitude
python_script_3 = Python(IN[0]=python_script, IN[1]=python_script_2, IN[2]=часовой_пояс_utc, IN[3]=string_from_array, IN[4]=string_from_array_2, IN[5]=расчетный_шаг_минута)
# ---------- python_script_3.python (105 lines) ----------
# Enable the use of standard Python libraries
import math
from datetime import datetime, timedelta

# For example:
# IN[0] = latitude
# IN[1] = longitude
# IN[2] = timezone
# IN[3] = start_datetime_string ("YYYY-MM-DD HH:MM")
# IN[4] = end_datetime_string ("YYYY-MM-DD HH:MM")
# IN[5] = step_minutes

lat = IN[0]
lon = IN[1]
tz = IN[2]
start_dt = datetime.strptime(IN[3], "%d.%m.%Y %H:%M:%S")
end_dt = datetime.strptime(IN[4], "%d.%m.%Y %H:%M:%S")
step = IN[5]

# Define the function to calculate sun position
def calculate_sun_position(year, month, day, hour, minute, lat, lon, tz):
    """
    High-precision calculation of sun position (azimuth and altitude).
    Accuracy is about ±0.05° with correct time and coordinates.
    """
    # Convert coordinates
    lat_rad = math.radians(lat)
    lon = float(lon)

    # Date and time
    dt = datetime(year, month, day, hour, minute)
    day_of_year = dt.timetuple().tm_yday
    time_utc = hour - tz + minute / 60.0

    # 1. Fractional year (in radians)
    gamma = 2 * math.pi / 365 * (day_of_year - 1 + (time_utc - 12) / 24)

    # 2. Equation of time (in minutes)
    eqtime = 229.18 * (
        0.000075
        + 0.001868 * math.cos(gamma)
        - 0.032077 * math.sin(gamma)
        - 0.014615 * math.cos(2*gamma)
        - 0.040849 * math.sin(2*gamma)
    )

    # 3. Solar declination (in radians)
    decl = (
        0.006918
        - 0.399912 * math.cos(gamma)
        + 0.070257 * math.sin(gamma)
        - 0.006758 * math.cos(2*gamma)
        + 0.000907 * math.sin(2*gamma)
        - 0.002697 * math.cos(3*gamma)
        + 0.00148 * math.sin(3*gamma)
    )

    # 4. Hour Angle
    time_offset = eqtime + 4 * lon
    tst = time_utc * 60 + time_offset
    ha = math.radians(tst / 4 - 180)

    # 5. Sun Altitude
    altitude_geom = math.degrees(
        math.asin(
            math.sin(lat_rad) * math.sin(decl)
            + math.cos(lat_rad) * math.cos(decl) * math.cos(ha)
        )
    )

    # 6. Atmospheric refraction
    if altitude_geom > -1:
        refraction = 1.02 / math.tan(math.radians(altitude_geom + 10.3/(altitude_geom + 5.11))) / 60
    else:
        refraction = 0
    altitude = altitude_geom + refraction

    # 7. Azimuth
    azimuth = math.degrees(
        math.atan2(
            -math.sin(ha),
            math.tan(decl) * math.cos(lat_rad)
            - math.sin(lat_rad) * math.cos(ha)
        )
    )
    azimuth = (azimuth + 360) % 360

    return azimuth, altitude

# Define the function to calculate a trajectory over time
def calculate_sun_trajectory(lat, lon, tz, start_dt, end_dt, step):
    result = []
    current_dt = start_dt
    while current_dt <= end_dt:
        az, alt = calculate_sun_position(
            current_dt.year, current_dt.month, current_dt.day,
            current_dt.hour, current_dt.minute,
            lat, lon, tz
        )
        result.append((current_dt, az, alt))
        current_dt += timedelta(minutes=step)
    return result


OUT = calculate_sun_trajectory(lat, lon, tz, start_dt, end_dt, step)
# ----------------------------------------

# group: Get Altitudes
code_block_5 = CodeBlock { 2; }
getItemAtIndex_2 = List.GetItemAtIndex(list=python_script_3@L2, index=code_block_5)

# group: Altitude rotation
XAxis = Vector.XAxis()
rotate_2 = Vector.Rotate(vector=rotate, axis=XAxis, degrees=getItemAtIndex_2)

# group: Get Azimuths
code_block_6 = CodeBlock { 1; }
getItemAtIndex_3 = List.GetItemAtIndex(list=python_script_3@L2, index=code_block_6)

code_block_7 = CodeBlock(a=getItemAtIndex_3) { -a; }

# group: Azimuth rotation
ZAxis_2 = Vector.ZAxis()
rotate_3 = Vector.Rotate(vector=rotate_2, axis=ZAxis_2, degrees=code_block_7)

# group: Get Ray Bounce, drop rays that bounce.
n3d_вид_для_анализа = Views("АНАЛИЗ_Исноляция_3D")  # "3D вид для анализа"; graph input
boolean = BoolSelector(false)
raybounce_on_linked_model = Custom[RayBounce On Linked Model](Points=getItemAtIndex, Direction=rotate_3, ThreeDView=n3d_вид_для_анализа, BounceOnLinkOnly=boolean)  # package Data-Shapes; Same functionality as raybounce but takes linked model elements into account
isNull = Object.IsNull(obj=raybounce_on_linked_model.Elements)
flatten = List.Flatten(list=isNull)

# group: Get rays VECTOR
filterByBoolMask_2 = List.FilterByBoolMask(list=rotate_3, mask=flatten)
flatten_2 = List.Flatten(list=filterByBoolMask_2.in)

# group: Get Time
code_block_8 = CodeBlock { 0; }
getItemAtIndex_4 = List.GetItemAtIndex(list=python_script_3@L2, index=code_block_8)

# group: Get rays TIME
filterByBoolMask_3 = List.FilterByBoolMask(list=getItemAtIndex_4, mask=flatten)

# group: Recognize PERIODS of time list
string_from_object_2 = FromObject(obj=filterByBoolMask_3.in)
string_2 = StringInput(" ")
split = String.Split(str=string_from_object_2, separator0=string_2)
lastItem = List.LastItem(list=split@L2)
python_script_4 = Python(IN[0]=lastItem, IN[1]=расчетный_шаг_минута)
# ---------- python_script_4.python (54 lines) ----------
from datetime import datetime, timedelta

# Входы из Dynamo
times_str = IN[0]          # список строк формата "HH:MM:SS"
step_minutes = IN[1]        # шаг в минутах (число)

# Конвертируем строки в datetime
times = [datetime.strptime(t, "%H:%M:%S") for t in times_str]

# Удаляем подряд идущие дубликаты времени
def remove_consecutive_duplicates(dt_list):
    if not dt_list:
        return dt_list
    out = [dt_list[0]]
    for t in dt_list[1:]:
        if t != out[-1]:
            out.append(t)
    return out

times = remove_consecutive_duplicates(times)

periods = []
if times:
    start_time = times[0]
    prev_time = times[0]
    start_idx = 0  # индекс начала периода

    for idx, current in enumerate(times[1:], start=1):
        delta = current - prev_time

        # Игнорируем дубликаты (хоть и они уже удалены, на всякий случай)
        if delta == timedelta(0):
            continue

        if delta == timedelta(minutes=step_minutes):
            prev_time = current
        else:
            # Только если период действительно длился
            if prev_time != start_time:
                ray_indxs = list(range(start_idx, idx))
                duration = int((prev_time - start_time).total_seconds() / 60) + step_minutes
                periods.append((start_time.time(), prev_time.time(), duration, ray_indxs))
            start_time = current
            prev_time = current
            start_idx = idx

    # последний период
    ray_indxs = list(range(start_idx, len(times)))
    if prev_time != start_time:
        duration = int((prev_time - start_time).total_seconds() / 60) + step_minutes
        periods.append((start_time.time(), prev_time.time(), duration, ray_indxs))

# Вывод
OUT = periods
# ----------------------------------------
lastItem_2 = List.LastItem(list=python_script_4@L3)
getItemAtIndex_5 = List.GetItemAtIndex(list=flatten_2, index=lastItem_2)

# group: SUN RAY vector visualise for Segment Family on plan view
длина_визуализации_сегмента_на = DoubleSlider(100, range=2..10000 step 1)  # "Длина визуализации сегмента на Плане (м)"
code_block_9 = CodeBlock(a=длина_визуализации_сегмента_на) { a*1000; }
byStartPointDirectionLength_3 = Line.ByStartPointDirectionLength(startPoint=getItemAtIndex, direction=getItemAtIndex_5, length=code_block_9)

first_and_last_vectors_with = Python(IN[0]=byStartPointDirectionLength_3)  # "First and last vectors with ierarchie"
# ---------- first_and_last_vectors_with.python (9 lines) ----------
# IN[0] — ваш список из кортежей/списков
data = IN[0]

# для каждого элемента берем первый и последний элементы
OUT = [ (t[0], t[-1]) if isinstance(t, (list, tuple)) and len(t) >= 2 else None for t in data ]

# Пример:
# input  -> [(a, b), (a, b, c, d), (a, b, c)]
# output -> [(a, b), (a, d), (a, c)]
# ----------------------------------------

# group: Create 3d DirectShape for ray segments
endPoint = Curve.EndPoint(curve=first_and_last_vectors_with)
addItemToFront = List.AddItemToFront(item=getItemAtIndex, list=endPoint@L2)
code_block_10 = CodeBlock { 0; }
code_block_11 = CodeBlock { 1; }
code_block_12 = CodeBlock { 2; }
byIndices = IndexGroup.ByIndices(a=code_block_10, b=code_block_11, c=code_block_12)
byPointsFaceIndices = Mesh.ByPointsFaceIndices(vertexPositions=addItemToFront@L2, indices=byIndices)
categories = Categories("OST_Mass")
count = List.Count(list=first_and_last_vectors_with)
code_block_13 = CodeBlock(a=count) { (1..a); }
code_block_14 = CodeBlock(a=id, b=code_block_13) { "RayForm_"+a+"_"+b; }
byMesh = DirectShape.ByMesh(mesh=byPointsFaceIndices, category=categories, name=code_block_14)
