# Dynamo graph FILIN_РасчетИнсоляции_ВсеСемейства.dyn (Dynamo 2.6.1.8786)

# group: ProjectNorth VECTOR Z = 0 X--NORTH Y--WEST/EAST
surveyPoint = Coordinates.SurveyPoint()
X = Point.X(point=surveyPoint)
Y = Point.Y(point=surveyPoint)
Z = CodeBlock { 0; }
byCoordinates = Point.ByCoordinates(x=X, y=Y, z=Z)
x = CodeBlock { 0; }
Y_2 = CodeBlock { 1; }
byCoordinates_2 = Vector.ByCoordinates(x=x, y=Y_2, z=Z)

# group: True North Vector
ZAxis = Vector.ZAxis()
projectRotation = Coordinates.ProjectRotation()
rotate = Vector.Rotate(vector=byCoordinates_2, axis=ZAxis, degrees=projectRotation)

# group: True North Vector visualise
number_slider = DoubleSlider(1000, range=5..10000 step 1)  # frozen
code_block = CodeBlock(a=number_slider) { a*1000; }
byStartPointDirectionLength = Line.ByStartPointDirectionLength(startPoint=byCoordinates, direction=rotate, length=code_block)

# group: ProjectNorth VECTOR visualise
number_slider_2 = DoubleSlider(50, range=5..10000 step 1)  # frozen
code_block_2 = CodeBlock(a=number_slider_2) { a*1000; }
byStartPointDirectionLength_2 = Line.ByStartPointDirectionLength(startPoint=byCoordinates, direction=byCoordinates_2, length=code_block_2)

# group: ClockWork Rotation From TrueNorth to ProjectNorth
angleWithVector = Vector.AngleWithVector(vector=byCoordinates_2, otherVector=rotate)  # frozen

# group: GET all Study points
family_types = FamilyTypes("Вл_PRM_ЦентрИнсоляции_R21(Окна):ЦентрИнсоляции_Тех")
all_elements_of_family_type = ElementsOfFamilyType(Family_Type=family_types)

# group: Get center point
getLocation = Element.GetLocation(element=all_elements_of_family_type)

# group: Set Start and End time
год = DoubleSlider(2020, range=2020..5000 step 1)  # graph input
месяц = DoubleSlider(4, range=1..12 step 1)  # graph input
день = DoubleSlider(22, range=1..31 step 1)  # graph input
начало_расчета_час = DoubleSlider(6, range=0..24 step 1)  # graph input
начало_расчета_минута = DoubleSlider(0, range=0..60 step 1)  # graph input
list_create = List.Create(item0=год, item1=месяц, item2=день, item3=начало_расчета_час, item4=начало_расчета_минута)
конец_расчета_час = DoubleSlider(18, range=0..24 step 1)  # graph input
конец_расчета_минута = DoubleSlider(0, range=0..60 step 1)  # graph input
list_create_2 = List.Create(item0=год, item1=месяц, item2=день, item3=конец_расчета_час, item4=конец_расчета_минута)

# group: Set calculation time period
расчетный_шаг_минута = DoubleSlider(10, range=0..60 step 1)  # graph input

# group: Get Project Coordinates
siteLocation = SiteLocation()
latitude = DynamoUnits.Location.Latitude(location=siteLocation)
longitude = DynamoUnits.Location.Longitude(location=siteLocation)

# group: Set +-: North + \ South - East + \ West-
широта_n_северная_s_южная = StringInput("N")  # graph input
python_script = Python(IN[0]=latitude, IN[1]=широта_n_северная_s_южная)
# ---------- python_script.python (18 lines) ----------
# Загрузить стандартную библиотеку Python и библиотеку DesignScript
import sys
import clr
clr.AddReference('ProtoGeometry')
from Autodesk.DesignScript.Geometry import *

lat=IN[0]
NS=IN[1]
TrueLat=()

NS=NS.upper()
if NS == "N":
	TrueLat=lat
if NS =="S":
	TrueLat=lat*-1

# Назначьте вывод переменной OUT.
OUT = TrueLat
# ----------------------------------------
долгота_e_восточная_w_западная = StringInput("E")  # graph input
python_script_2 = Python(IN[0]=longitude, IN[1]=долгота_e_восточная_w_западная)
# ---------- python_script_2.python (19 lines) ----------
# Загрузить стандартную библиотеку Python и библиотеку DesignScript
import sys
import clr
clr.AddReference('ProtoGeometry')
from Autodesk.DesignScript.Geometry import *

long=IN[0]
WE=IN[1]
TrueLong=()
exeption=()

WE=WE.upper()
if WE == "E":
	TrueLong=long
if WE =="W":
	TrueLong=long*-1

# Назначьте вывод переменной OUT.
OUT = TrueLong
# ----------------------------------------

# group: Set Timezone
часовой_пояс_utc = DoubleSlider(3, range=0..60 step 1)  # graph input

sunTrajectoryLiteSPA = FILIN_SiteFeasibility.SolarStudy.SunTrajectoryLiteSPA(startTime=list_create, endTime=list_create_2, stepMinutes=расчетный_шаг_минута, latitude=python_script, longitude=python_script_2, utcOffset=часовой_пояс_utc)
string = StringInput("Altitude")
valueAtKey = DesignScript.Builtin.Dictionary.ValueAtKey(dictionary=sunTrajectoryLiteSPA, key=string)

# group: Altitude rotation
XAxis = Vector.XAxis()
rotate_2 = Vector.Rotate(vector=rotate, axis=XAxis, degrees=valueAtKey)

string_2 = StringInput("Azimuth")
valueAtKey_2 = DesignScript.Builtin.Dictionary.ValueAtKey(dictionary=sunTrajectoryLiteSPA, key=string_2)
code_block_3 = CodeBlock(a=valueAtKey_2) { -a; }

# group: Azimuth rotation
ZAxis_2 = Vector.ZAxis()
rotate_3 = Vector.Rotate(vector=rotate_2, axis=ZAxis_2, degrees=code_block_3)

# group: Get Ray Bounce, drop rays that bounce.
n3d_вид_для_анализа = Views("{3D}")  # "3D вид для анализа"; graph input
rayBounce = Custom[RayBounce](Points=getLocation@L1, Direction=rotate_3, 3D_View=n3d_вид_для_анализа)
code_block_4 = CodeBlock { false; }
allIndicesOf = List.AllIndicesOf(list=rayBounce@L2, item=code_block_4)

# group: get Indxs
python_script_3 = Python(IN[0]=allIndicesOf)
# ---------- python_script_3.python (23 lines) ----------
data = IN[0]
result = []

for sublist in data:
    if not sublist:
        result.append([])
        continue
        
    grouped = [[sublist[0]]] # Начинаем с первого элемента
    
    for i in range(1, len(sublist)):
        # Если текущий элемент на 1 больше предыдущего — добавляем в ту же группу
        if sublist[i] == sublist[i-1] + 1:
            grouped[-1].append(sublist[i])
        else:
            # Если есть разрыв — создаем новую группу
            grouped.append([sublist[i]])
            
    # Фильтруем: оставляем только группы, где длина > 1
    filtered_groups = [g for g in grouped if len(g) > 1]
    result.append(filtered_groups)

OUT = result
# ----------------------------------------
first_and_last_vectors_with = Python(IN[0]=python_script_3)  # "First and last vectors with ierarchie"
# ---------- first_and_last_vectors_with.python (15 lines) ----------
data = IN[0]

def transform(item):
    # Проверяем, является ли элемент списком или кортежем
    if isinstance(item, (list, tuple)) and len(item) > 0:
        # Если первый элемент — тоже коллекция, идем глубже (рекурсия)
        if isinstance(item[0], (list, tuple)):
            return [transform(sub) for sub in item]
        
        # Если это конечный список данных — берем первый и последний
        return (item[0], item[-1])
    
    return item

OUT = transform(data)
# ----------------------------------------

# group: Range of point for ray segemt synhronized with origin point(oirgin = origin* n of segments)
count = List.Count(list=python_script_3@@L3)
ofRepeatedItem = List.OfRepeatedItem(item=getLocation, amount=count, lacing=Shortest)

# group: Place Instances to star point
семейство_уго_сегмента_инсоляции = FamilyTypes("FILI_ИнсоляционныйСегмент_R21(ОбМод):ИнсоляцонныйСегмент")  # graph input
byPoint = FamilyInstance.ByPoint(familyType=семейство_уго_сегмента_инсоляции, point=ofRepeatedItem)

# group: SUN ALL RAY vectors visualise
длина_луча_м_визуализация = DoubleSlider(500, range=5..10000 step 1)  # graph input
code_block_5 = CodeBlock(a=длина_луча_м_визуализация) { a*1000; }
byStartPointDirectionLength_3 = Line.ByStartPointDirectionLength(startPoint=getLocation@L1, direction=rotate_3, length=code_block_5)

direction = Line.Direction(line=byStartPointDirectionLength_3)

# group: Get rays VECTOR
getItemAtIndex = List.GetItemAtIndex(list=direction@@L2, index=first_and_last_vectors_with@L3)

# group: SUN RAY vector visualise for Segment Family on plan view
длина_визуализации_сегмента_на = DoubleSlider(500, range=2..10000 step 1)  # "Длина визуализации сегмента на Плане (м)"
code_block_6 = CodeBlock(a=длина_визуализации_сегмента_на) { a*1000; }
byStartPointDirectionLength_4 = Line.ByStartPointDirectionLength(startPoint=getLocation, direction=getItemAtIndex, length=code_block_6)

# group: Pull Countor lines on generated Plane
ZAxis_3 = Vector.ZAxis()
byOriginNormal = Plane.ByOriginNormal(normal=ZAxis_3)
pullOntoPlane = Curve.PullOntoPlane(curve=byStartPointDirectionLength_4, plane=byOriginNormal)

# group: Pulled curves to line to vectors.
startPoint = Curve.StartPoint(curve=pullOntoPlane)
endPoint = Curve.EndPoint(curve=pullOntoPlane)
byStartPointEndPoint = Line.ByStartPointEndPoint(startPoint=startPoint, endPoint=endPoint)
direction_2 = Line.Direction(line=byStartPointEndPoint)

# group: Vectors to angle between
firstItem = List.FirstItem(list=direction_2@L2)
lastItem = List.LastItem(list=direction_2@L2)
angleWithVector_2 = Vector.AngleWithVector(vector=firstItem, otherVector=lastItem)

# group: Rotate from project North
angleWithVector_3 = Vector.AngleWithVector(vector=byCoordinates_2, otherVector=firstItem)
code_block_7 = CodeBlock(a=angleWithVector_3, b=angleWithVector_2) { a+b/2; }
setRotation = FamilyInstance.SetRotation(familyInstance=byPoint, degree=code_block_7)
intstance_ID = Python(IN[0]=setRotation)
# ---------- intstance_ID.python (15 lines) ----------
# IN[0] — список FamilyInstance (или одиночный элемент)
elems = IN[0]
if not isinstance(elems, (list, tuple)):
    elems = [elems]

ids = []
for e in elems:
    # Разгибаем Dynamo wrapper до реального элемента, если нужно
    obj = getattr(e, 'InternalElement', e)
    if hasattr(obj, 'Id') and hasattr(obj.Id, 'IntegerValue'):
        ids.append(obj.Id.IntegerValue)
    else:
        ids.append(None)

OUT = ids
# ----------------------------------------
element_by_id = ElementById(Id=intstance_ID)

# group: <Set Segment Lenght
string_3 = StringInput("SegmentLenght")
длина_визуализации_сегмента_на_2 = DoubleSlider(2, range=2..10000 step 1)  # "Длина визуализации сегмента на Плане (м)"; graph input
code_block_8 = CodeBlock(a=длина_визуализации_сегмента_на_2) { a*1000; }
setParameterByName = Element.SetParameterByName(element=setRotation, parameterName=string_3, value=code_block_8)

# group: Segment Angle
string_4 = StringInput("SegmentAngle")
setParameterByName_2 = Element.SetParameterByName(element=setRotation, parameterName=string_4, value=angleWithVector_2)

# group: Calculate All insolation Time in minutes
count_2 = List.Count(list=python_script_3@@L2)
code_block_9 = CodeBlock(a=count_2) { a-1; }
code_block_10 = CodeBlock(a=code_block_9, b=расчетный_шаг_минута) { a*b; }
sum = Math.Sum(values=code_block_10)

# group: Set Time to segment>
string_5 = StringInput("FILI_ВремяИнсоляции_Сегмент")
setParameterByName_3 = Element.SetParameterByName(element=setRotation, parameterName=string_5, value=code_block_10)

string_6 = StringInput("Time")
valueAtKey_3 = DesignScript.Builtin.Dictionary.ValueAtKey(dictionary=sunTrajectoryLiteSPA, key=string_6)

# group: Get rays TIME
count_3 = List.Count(list=all_elements_of_family_type)
ofRepeatedItem_2 = List.OfRepeatedItem(item=valueAtKey_3, amount=count_3)
getItemAtIndex_2 = List.GetItemAtIndex(list=ofRepeatedItem_2@@L2, index=first_and_last_vectors_with@L3)

# group: Time periods as string HH:mm-HH:mm;HH:mm-HH:mm
string_7 = StringInput("; ")
code_block_11 = CodeBlock { 0; }
getItemAtIndex_3 = List.GetItemAtIndex(list=getItemAtIndex_2@@L2, index=code_block_11)
code_block_12 = CodeBlock { 1; }
getItemAtIndex_4 = List.GetItemAtIndex(list=getItemAtIndex_2@@L2, index=code_block_12)
code_block_13 = CodeBlock(a=getItemAtIndex_3, b=getItemAtIndex_4) { a+"-"+b; }
join = String.Join(separator=string_7@@L2, string0=code_block_13)

# group: Set Time period to segment>
string_8 = StringInput("FILI_ПериодИнсоляции")
setParameterByName_4 = Element.SetParameterByName(element=element_by_id, parameterName=string_8, value=join)

# group: Return all Parents of Points
getParentElement = Element.GetParentElement(element=all_elements_of_family_type)

# group: SET insulation TIME to PARENT
string_9 = StringInput("FILI_ОбщееВремяИнсоляции_Точка")
setParameterByName_5 = Element.SetParameterByName(element=getParentElement, parameterName=string_9, value=sum)

string_10 = StringInput("""                    GNU GENERAL PUBLIC LICENSE
                       Version 3, 29 June 2007

 Copyright (C) 2007 Free Software Foundation, Inc. <https://fsf.org/>
 Everyone is permitted to copy and distribute verbatim copies
 of this license document, but changing it is not allowed.

                            Preamble

  The GNU General Public License is a free, copyleft license for
software and other kinds of works.

  The licenses for most software and other practical works are designed
to take away your freedom to share and change the works.  By contrast,
the GNU General Public License is intended to guarantee your freedom to
share and change all versions of a program--to make sure it remains free
software for all its users.  We, the Free Software Foundation, use the
GNU General Public License for most of our software; it applies also to
any other work released this way by its authors.  You can apply it to
your programs, too.

  When we speak of free software, we are referring to freedom, not
price.  Our General Public Licenses are designed to make sure that you
have the freedom to distribute copies of free software (and charge for
them if you wish), that you receive source code or can get it if you
want it, that you can change the software or use pieces of it in new
free programs, and that you know you can do these things.

  To protect your rights, we need to prevent others from denying you
these rights or asking you to surrender the rights.  Therefore, you have
certain responsibilities if you distribute copies of the software, or if
you modify it: responsibilities to respect the freedom of others.

  For example, if you distribute copies of such a program, whether
gratis or for a fee, you must pass on to the recipients the same
freedoms that you received.  You must make sure that they, too, receive
or can get the source code.  And you must show them these terms so they
know their rights.

  Developers that use the GNU GPL protect your rights with two steps:
(1) assert copyright on the software, and (2) offer you this License
giving you legal permission to copy, distribute and/or modify it.

  For the developers' and authors' protection, the GPL clearly explains
that there is no warranty for this free software.  For both users' and
authors' sake, the GPL requires that modified versions be marked as
changed, so that their problems will not be attributed erroneously to
authors of previous versions.

  Some devices are designed to deny users access to install or run
modified versions of the software inside them, although the manufacturer
can do so.  This is fundamentally incompatible with the aim of
protecting users' freedom to change the software.  The systematic
pattern of such abuse occurs in the area of products for individuals to
use, which is precisely where it is most unacceptable.  Therefore, we
have designed this version of the GPL to prohibit the practice for those
products.  If such problems arise substantially in other domains, we
stand ready to extend this provision to those domains in future versions
of the GPL, as needed to protect the freedom of users.

  Finally, every program is threatened constantly by software patents.
States should not allow patents to restrict development and use of
software on general-purpose computers, but in those that do, we wish to
avoid the special danger that patents applied to a free program could
make it effectively proprietary.  To prevent this, the GPL assures that
patents cannot be used to render the program non-free.

  The precise terms and conditions for copying, distribution and
modification follow.

                       TERMS AND CONDITIONS

  0. Definitions.

  "This License" refers to version 3 of the GNU General Public License.

  "Copyright" also means copyright-like laws that apply to other kinds of
works, such as semiconductor masks.

  "The Program" refers to any copyrightable work licensed under this
License.  Each licensee is addressed as "you".  "Licensees" and
"recipients" may be individuals or organizations.

  To "modify" a work means to copy from or adapt all or part of the work
in a fashion requiring copyright permission, other than the making of an
exact copy.  The resulting work is called a "modified version" of the
earlier work or a work "based on" the earlier work.

  A "covered work" means either the unmodified Program or a work based
on the Program.

  To "propagate" a work means to do anything with it that, without
permission, would make you directly or secondarily liable for
infringement under applicable copyright law, except executing it on a
computer or modifying a private copy.  Propagation includes copying,
distribution (with or without modification), making available to the
public, and in some countries other activities as well.

  To "convey" a work means any kind of propagation that enables other
parties to make or receive copies.  Mere interaction with a user through
a computer network, with no transfer of a copy, is not conveying.

  An interactive user interface displays "Appropriate Legal Notices"
to the extent that it includes a convenient and prominently visible
feature that (1) displays an appropriate copyright notice, and (2)
tells the user that there is no warranty for the work (except to the
extent that warranties are provided), that licensees may convey the
work under this License, and how to view a copy of this License.  If
the interface presents a list of user commands or options, such as a
menu, a prominent item in the list meets this criterion.

  1. Source Code.

  The "source code" for a work means the preferred form of the work
for making modifications to it.  "Object code" means any non-source
form of a work.

  A "Standard Interface" means an interface that either is an official
standard defined by a recognized standards body, or, in the case of
interfaces specified for a particular programming language, one that
is widely used among developers working in that language.

  The "System Libraries" of an executable work include anything, other
than the work as a whole, that (a) is included in the normal form of
packaging a Major Component, but which is not part of that Major
Component, and (b) serves only to enable use of the work with that
Major Component, or to implement a Standard Interface for which an
implementation is available to the public in source code form.  A
"Major Component", in this context, means a major essential component
(kernel, window system, and so on) of the specific operating system
(if any) on which the executable work runs, or a compiler used to
produce the work, or an object code interpreter used to run it.

  The "Corresponding Source" for a work in object code form means all
the source code needed to generate, install, and (for an executable
work) run the object code and to modify the work, including scripts to
control those activities.  However, it does not include the work's
System Libraries, or general-purpose tools or generally available free
programs which are used unmodified in performing those activities but
which are not part of the work.  For example, Corresponding Source
includes interface definition files associated with source files for
the work, and the source code for shared libraries and dynamically
linked subprograms that the work is specifically designed to require,
such as by intimate data communication or control flow between those
subprograms and other parts of the work.

  The Corresponding Source need not include anything that users
can regenerate automatically from other parts of the Corresponding
Source.

  The Corresponding Source for a work in source code form is that
same work.

  2. Basic Permissions.

  All rights granted under this License are granted for the term of
copyright on the Program, and are irrevocable provided the stated
conditions are met.  This License explicitly affirms your unlimited
permission to run the unmodified Program.  The output from running a
covered work is covered by this License only if the output, given its
content, constitutes a covered work.  This License acknowledges your
rights of fair use or other equivalent, as provided by copyright law.

  You may make, run and propagate covered works that you do not
convey, without conditions so long as your license otherwise remains
in force.  You may convey covered works to others for the sole purpose
of having them make modifications exclusively for you, or provide you
with facilities for running those works, provided that you comply with
the terms of this License in conveying all material for which you do
not control copyright.  Those thus making or running the covered works
for you must do so exclusively on your behalf, under your direction
and control, on terms that prohibit them from making any copies of
your copyrighted material outside their relationship with you.

  Conveying under any other circumstances is permitted solely under
the conditions stated below.  Sublicensing is not allowed; section 10
makes it unnecessary.

  3. Protecting Users' Legal Rights From Anti-Circumvention Law.

  No covered work shall be deemed part of an effective technological
measure under any applicable law fulfilling obligations under article
11 of the WIPO copyright treaty adopted on 20 December 1996, or
similar laws prohibiting or restricting circumvention of such
measures.

  When you convey a covered work, you waive any legal power to forbid
circumvention of technological measures to the extent such circumvention
is effected by exercising rights under this License with respect to
the covered work, and you disclaim any intention to limit operation or
modification of the work as a means of enforcing, against the work's
users, your or third parties' legal rights to forbid circumvention of
technological measures.

  4. Conveying Verbatim Copies.

  You may convey verbatim copies of the Program's source code as you
receive it, in any medium, provided that you conspicuously and
appropriately publish on each copy an appropriate copyright notice;
keep intact all notices stating that this License and any
non-permissive terms added in accord with section 7 apply to the code;
keep intact all notices of the absence of any warranty; and give all
recipients a copy of this License along with the Program.

  You may charge any price or no price for each copy that you convey,
and you may offer support or warranty protection for a fee.

  5. Conveying Modified Source Versions.

  You may convey a work based on the Program, or the modifications to
produce it from the Program, in the form of source code under the
terms of section 4, provided that you also meet all of these conditions:

    a) The work must carry prominent notices stating that you modified
    it, and giving a relevant date.

    b) The work must carry prominent notices stating that it is
    released under this License and any conditions added under section
    7.  This requirement modifies the requirement in section 4 to
    "keep intact all notices".

    c) You must license the entire work, as a whole, under this
    License to anyone who comes into possession of a copy.  This
    License will therefore apply, along with any applicable section 7
    additional terms, to the whole of the work, and all its parts,
    regardless of how they are packaged.  This License gives no
    permission to license the work in any other way, but it does not
    invalidate such permission if you have separately received it.

    d) If the work has interactive user interfaces, each must display
    Appropriate Legal Notices; however, if the Program has interactive
    interfaces that do not display Appropriate Legal Notices, your
    work need not make them do so.

  A compilation of a covered work with other separate and independent
works, which are not by their nature extensions of the covered work,
and which are not combined with it such as to form a larger program,
in or on a volume of a storage or distribution medium, is called an
"aggregate" if the compilation and its resulting copyright are not
used to limit the access or legal rights of the compilation's users
beyond what the individual works permit.  Inclusion of a covered work
in an aggregate does not cause this License to apply to the other
parts of the aggregate.

  6. Conveying Non-Source Forms.

  You may convey a covered work in object code form under the terms
of sections 4 and 5, provided that you also convey the
machine-readable Corresponding Source under the terms of this License,
in one of these ways:

    a) Convey the object code in, or embodied in, a physical product
    (including a physical distribution medium), accompanied by the
    Corresponding Source fixed on a durable physical medium
    customarily used for software interchange.

    b) Convey the object code in, or embodied in, a physical product
    (including a physical distribution medium), accompanied by a
    written offer, valid for at least three years and valid for as
    long as you offer spare parts or customer support for that product
    model, to give anyone who possesses the object code either (1) a
    copy of the Corresponding Source for all the software in the
    product that is covered by this License, on a durable physical
    medium customarily used for software interchange, for a price no
    more than your reasonable cost of physically performing this
    conveying of source, or (2) access to copy the
    Corresponding Source from a network server at no charge.

    c) Convey individual copies of the object code with a copy of the
    written offer to provide the Corresponding Source.  This
    alternative is allowed only occasionally and noncommercially, and
    only if you received the object code with such an offer, in accord
    with subsection 6b.

    d) Convey the object code by offering access from a designated
    place (gratis or for a charge), and offer equivalent access to the
    Corresponding Source in the same way through the same place at no
    further charge.  You need not require recipients to copy the
    Corresponding Source along with the object code.  If the place to
    copy the object code is a network server, the Corresponding Source
    may be on a different server (operated by you or a third party)
    that supports equivalent copying facilities, provided you maintain
    clear directions next to the object code saying where to find the
    Corresponding Source.  Regardless of what server hosts the
    Corresponding Source, you remain obligated to ensure that it is
    available for as long as needed to satisfy these requirements.

    e) Convey the object code using peer-to-peer transmission, provided
    you inform other peers where the object code and Corresponding
    Source of the work are being offered to the general public at no
    charge under subsection 6d.

  A separable portion of the object code, whose source code is excluded
from the Corresponding Source as a System Library, need not be
included in conveying the object code work.

  A "User Product" is either (1) a "consumer product", which means any
tangible personal property which is normally used for personal, family,
or household purposes, or (2) anything designed or sold for incorporation
into a dwelling.  In determining whether a product is a consumer product,
doubtful cases shall be resolved in favor of coverage.  For a particular
product received by a particular user, "normally used" refers to a
typical or common use of that class of product, regardless of the status
of the particular user or of the way in which the particular user
actually uses, or expects or is expected to use, the product.  A product
is a consumer product regardless of whether the product has substantial
commercial, industrial or non-consumer uses, unless such uses represent
the only significant mode of use of the product.

  "Installation Information" for a User Product means any methods,
procedures, authorization keys, or other information required to install
and execute modified versions of a covered work in that User Product from
a modified version of its Corresponding Source.  The information must
suffice to ensure that the continued functioning of the modified object
code is in no case prevented or interfered with solely because
modification has been made.

  If you convey an object code work under this section in, or with, or
specifically for use in, a User Product, and the conveying occurs as
part of a transaction in which the right of possession and use of the
User Product is transferred to the recipient in perpetuity or for a
fixed term (regardless of how the transaction is characterized), the
Corresponding Source conveyed under this section must be accompanied
by the Installation Information.  But this requirement does not apply
if neither you nor any third party retains the ability to install
modified object code on the User Product (for example, the work has
been installed in ROM).

  The requirement to provide Installation Information does not include a
requirement to continue to provide support service, warranty, or updates
for a work that has been modified or installed by the recipient, or for
the User Product in which it has been modified or installed.  Access to a
network may be denied when the modification itself materially and
adversely affects the operation of the network or violates the rules and
protocols for communication across the network.

  Corresponding Source conveyed, and Installation Information provided,
in accord with this section must be in a format that is publicly
documented (and with an implementation available to the public in
source code form), and must require no special password or key for
unpacking, reading or copying.

  7. Additional Terms.

  "Additional permissions" are terms that supplement the terms of this
License by making exceptions from one or more of its conditions.
Additional permissions that are applicable to the entire Program shall
be treated as though they were included in this License, to the extent
that they are valid under applicable law.  If additional permissions
apply only to part of the Program, that part may be used separately
under those permissions, but the entire Program remains governed by
this License without regard to the additional permissions.

  When you convey a copy of a covered work, you may at your option
remove any additional permissions from that copy, or from any part of
it.  (Additional permissions may be written to require their own
removal in certain cases when you modify the work.)  You may place
additional permissions on material, added by you to a covered work,
for which you have or can give appropriate copyright permission.

  Notwithstanding any other provision of this License, for material you
add to a covered work, you may (if authorized by the copyright holders of
that material) supplement the terms of this License with terms:

    a) Disclaiming warranty or limiting liability differently from the
    terms of sections 15 and 16 of this License; or

    b) Requiring preservation of specified reasonable legal notices or
    author attributions in that material or in the Appropriate Legal
    Notices displayed by works containing it; or

    c) Prohibiting misrepresentation of the origin of that material, or
    requiring that modified versions of such material be marked in
    reasonable ways as different from the original version; or

    d) Limiting the use for publicity purposes of names of licensors or
    authors of the material; or

    e) Declining to grant rights under trademark law for use of some
    trade names, trademarks, or service marks; or

    f) Requiring indemnification of licensors and authors of that
    material by anyone who conveys the material (or modified versions of
    it) with contractual assumptions of liability to the recipient, for
    any liability that these contractual assumptions directly impose on

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""")  # frozen
