# Dynamo custom node ListScope.dyf (Dynamo 2.6.1.8786)
# category: FILIN_Dynamo

List = Input(_List: var)
first_and_last_vectors_with = Python(IN[0]=List)  # "First and last vectors with ierarchie"
# ---------- first_and_last_vectors_with.python (9 lines) ----------
# IN[0] — ваш список из кортежей/списков
data = IN[0]

# для каждого элемента берем первый и последний элементы
OUT = (data[0], data[-1]) if len(data) >= 2 else data

# Пример:
# input  -> [(a, b), (a, b, c, d), (a, b, c)]
# output -> [(a, b), (a, d), (a, c)]
# ----------------------------------------
Output = Output(first_and_last_vectors_with)
