# Dynamo custom node RayBounce.dyf (Dynamo 2.6.1.8786)
# category: FILIN_Dynamo

Points = Input(_Points: Autodesk.DesignScript.Geometry.Point[])
Direction = Input(_Direction: Autodesk.DesignScript.Geometry.Vector)
n3D_View = Input(_3D_View: Revit.Elements.Views.View3D)
python_script = Python(IN[0]=Points, IN[1]=Direction, IN[2]=n3D_View)
# ---------- python_script.python (45 lines) ----------
import clr
clr.AddReference('RevitAPI')
from Autodesk.Revit.DB import *

clr.AddReference('ProtoGeometry')
from Autodesk.DesignScript.Geometry import *

clr.AddReference('RevitServices')
from RevitServices.Persistence import DocumentManager

doc = DocumentManager.Instance.CurrentDBDocument

# Units
UIunit = Document.GetUnits(doc).GetFormatOptions(UnitType.UT_Length).DisplayUnits

# Inputs
if isinstance(IN[0], list):
    points = [XYZ(
        UnitUtils.ConvertToInternalUnits(i.X, UIunit),
        UnitUtils.ConvertToInternalUnits(i.Y, UIunit),
        UnitUtils.ConvertToInternalUnits(i.Z, UIunit)
    ) for i in IN[0]]
else:
    points = [XYZ(
        UnitUtils.ConvertToInternalUnits(IN[0].X, UIunit),
        UnitUtils.ConvertToInternalUnits(IN[0].Y, UIunit),
        UnitUtils.ConvertToInternalUnits(IN[0].Z, UIunit)
    )]

direction = XYZ(IN[1].X, IN[1].Y, IN[1].Z)
view = UnwrapElement(IN[2])

ri = ReferenceIntersector(view)
ri.FindReferencesInRevitLinks = True

# Главная логика
result = False

for p in points:
    ref = ri.FindNearest(p, direction)
    if ref is not None:
        result = True
        break  # сразу выходим — дальше проверять не нужно

OUT = result
# ----------------------------------------
Resault = Output(python_script)
